# Dynamo graph CubeUnfolding.dyn (Dynamo 0.7.6.3486)

code_block = CodeBlock { 5; }
byLengths = Cuboid.ByLengths(code_block, code_block, code_block)
faces = Topology.Faces(byLengths)
unfoldListOfFaces = DynamoUnfold.Unfolding.UnfoldListOfFaces(faces)
surfaceGeometry = Face.SurfaceGeometry(faces)
code_block_2 = CodeBlock { 17; }
translate = Geometry.Translate(surfaceGeometry, code_block_2)
unfoldListOfSurfaces_AndReturnTransforms = DynamoUnfold.Unfolding.UnfoldListOfSurfaces_AndReturnTransforms(surfaceGeometry)
generateUnfoldedLabels = DynamoUnfold.Unfolding.GenerateUnfoldedLabels(unfoldListOfSurfaces_AndReturnTransforms.out1)
generateInitialLabels = DynamoUnfold.Unfolding.GenerateInitialLabels(unfoldListOfSurfaces_AndReturnTransforms.out1)
code_block_3 = CodeBlock(a=generateInitialLabels) { a[1]; }
contextCoordinateSystem = Geometry.ContextCoordinateSystem(code_block_3)
transformMap = DynamoUnfold.Unfolding._TransformMap(unfoldListOfSurfaces_AndReturnTransforms.out1)
code_block_4 = CodeBlock(a=transformMap) { a[1]; }
code_block_5 = CodeBlock(a=code_block_4) { a[0]; }
transform = Geometry.Transform(code_block_3, contextCoordinateSystem, code_block_5)
contextCoordinateSystem_2 = Geometry.ContextCoordinateSystem(transform)
code_block_6 = CodeBlock(a=code_block_4) { a[1]; }
transform_2 = Geometry.Transform(transform, contextCoordinateSystem_2, code_block_6)
contextCoordinateSystem_3 = Geometry.ContextCoordinateSystem(transform_2)
code_block_7 = CodeBlock(a=code_block_4) { a[2]; }
transform_3 = Geometry.Transform(transform_2, contextCoordinateSystem_3, code_block_7)
