# Dynamo graph CubeUnfoldingTranslatedLabelsTest.dyn (Dynamo 0.7.4.3245)

code_block = CodeBlock { 5; }
byLengths = Cuboid.ByLengths(code_block, code_block, code_block)
faces = Topology.Faces(byLengths)
surfaceGeometry = Face.SurfaceGeometry(faces)
code_block_2 = CodeBlock { 17; }
translate = Geometry.Translate(surfaceGeometry, code_block_2)
unfoldListOfSurfaces_AndReturnTransforms = DynamoUnfold.Unfolding.UnfoldListOfSurfaces_AndReturnTransforms(translate)
generateUnfoldedLabels = DynamoUnfold.Unfolding.GenerateUnfoldedLabels(unfoldListOfSurfaces_AndReturnTransforms.out1)
generateInitialLabels = DynamoUnfold.Unfolding.GenerateInitialLabels(unfoldListOfSurfaces_AndReturnTransforms.out1)
unfoldListOfSurfaces_AndReturnTransforms_2 = DynamoUnfold.Unfolding.UnfoldListOfSurfaces_AndReturnTransforms(surfaceGeometry)
generateInitialLabels_2 = DynamoUnfold.Unfolding.GenerateInitialLabels(unfoldListOfSurfaces_AndReturnTransforms_2.out1)
generateUnfoldedLabels_2 = DynamoUnfold.Unfolding.GenerateUnfoldedLabels(unfoldListOfSurfaces_AndReturnTransforms_2.out1)
