# Dynamo graph CurvedSurfaceTessellationUnfold.dyn (Dynamo 0.7.2.20192)

code_block = CodeBlock { 111; }
code_block_2 = CodeBlock { 12; }
packUnfoldedSurfaces = DynamoUnfold.Unfolding.PackUnfoldedSurfaces(arg1=code_block, arg2=code_block, arg3=code_block_2)
number = DoubleInput(4)
byCoordinates = Point.ByCoordinates(arg2=number)
number_2 = DoubleInput(1)
byCoordinates_2 = Point.ByCoordinates(number_2, number_2, number)
byCoordinates_3 = Point.ByCoordinates(arg1=number, arg2=number)
byThreePoints = Arc.ByThreePoints(byCoordinates, byCoordinates_2, byCoordinates_3)
byCoordinates_4 = Point.ByCoordinates()
number_3 = DoubleInput(2)
byCoordinates_5 = Point.ByCoordinates(number_3, number_3)
number_4 = DoubleInput(4)
byCoordinates_6 = Point.ByCoordinates(arg1=number_4)
byThreePoints_2 = Arc.ByThreePoints(byCoordinates_4, byCoordinates_5, byCoordinates_6)
create = List.Create(byThreePoints, byThreePoints_2)
byLoft = Surface.ByLoft(create)
code_block_3 = CodeBlock { 6; }
scale = Geometry.Scale(byLoft, code_block_3)
code_block_4 = CodeBlock { 15; }
tesselateSurfaces = DynamoUnfold.Unfolding._TesselateSurfaces(scale, arg2=code_block_4)
unfoldListOfSurfaces_AndReturnTransforms = DynamoUnfold.Unfolding.UnfoldListOfSurfaces_AndReturnTransforms(tesselateSurfaces)
apply = ApplyFunction(packUnfoldedSurfaces.out1, unfoldListOfSurfaces_AndReturnTransforms.out1)  # "Function.Apply"
code_block_5 = CodeBlock { 0.5; }
generateInitialLabels = DynamoUnfold.Unfolding.GenerateInitialLabels(apply, code_block_5)
generateUnfoldedLabels = DynamoUnfold.Unfolding.GenerateUnfoldedLabels(apply, code_block_5)
apply_2 = ApplyFunction(packUnfoldedSurfaces.out0, unfoldListOfSurfaces_AndReturnTransforms.out1)  # "Function.Apply"
