# Dynamo graph CurvedSurfaceTessellationUnfoldtesting.dyn (Dynamo 0.7.4.3245)

number = DoubleInput(4)
byCoordinates = Point.ByCoordinates(arg2=number)
number_2 = DoubleInput(1)
byCoordinates_2 = Point.ByCoordinates(number_2, number_2, number)
byCoordinates_3 = Point.ByCoordinates(arg1=number, arg2=number)
byThreePoints = Arc.ByThreePoints(byCoordinates, byCoordinates_2, byCoordinates_3)
byCoordinates_4 = Point.ByCoordinates()
number_3 = DoubleInput(2)
byCoordinates_5 = Point.ByCoordinates(number_3, number_3)
number_4 = DoubleInput(4)
byCoordinates_6 = Point.ByCoordinates(arg1=number_4)
byThreePoints_2 = Arc.ByThreePoints(byCoordinates_4, byCoordinates_5, byCoordinates_6)
create = List.Create(byThreePoints, byThreePoints_2)
byLoft = Surface.ByLoft(create)
code_block = CodeBlock { 6; }
scale = Geometry.Scale(byLoft, code_block)
code_block_2 = CodeBlock { 15; }
tesselateSurfaces = DynamoUnfold.Unfolding._TesselateSurfaces(scale, arg2=code_block_2)
code_block_3 = CodeBlock { 10; }
scale_2 = Geometry.Scale(tesselateSurfaces, code_block_3)
unfoldListOfSurfaces_AndReturnTransforms = DynamoUnfold.Unfolding.UnfoldListOfSurfaces_AndReturnTransforms(scale_2)
code_block_4 = CodeBlock { 111; }
code_block_5 = CodeBlock { 12; }
packUnfoldedSurfaces = DynamoUnfold.Unfolding.PackUnfoldedSurfaces(unfoldListOfSurfaces_AndReturnTransforms.out1, code_block_4, code_block_4, code_block_5)
code_block_6 = CodeBlock { 0.5; }
generateInitialLabels = DynamoUnfold.Unfolding.GenerateInitialLabels(packUnfoldedSurfaces.out1, code_block_6)
generateUnfoldedLabels = DynamoUnfold.Unfolding.GenerateUnfoldedLabels(packUnfoldedSurfaces.out1, code_block_6)
