# Dynamo graph SphereUnfold.dyn (Dynamo 0.7.2.28129)

origin = Point.Origin()
code_block = CodeBlock { 10; }
byCenterPointRadius = Sphere.ByCenterPointRadius(origin, code_block)
bySolid = PolySurface.BySolid(byCenterPointRadius)
surfaces = PolySurface.Surfaces(bySolid)
flatten = Flatten(surfaces)
code_block_2 = CodeBlock { 0..1..#15; 0..1..#10; }
pointAtParameter = Surface.PointAtParameter(flatten, code_block_2.out0, code_block_2.out1, lacing=CrossProduct)
code_block_3 = CodeBlock { 1; }
flatten_2 = List.Flatten(pointAtParameter, code_block_3)
transpose = List.Transpose(flatten_2)
byPoints = PolyCurve.ByPoints(transpose)
flatten_3 = Flatten(byPoints)
code_block_4 = CodeBlock { 0..1; 1; }
sublists = List.Sublists(flatten_3, code_block_4.out0, code_block_4.out1)
code_block_5 = CodeBlock(l=sublists) { List.Count(l) - 1; }
removeItemAtIndex = List.RemoveItemAtIndex(sublists, code_block_5)
byLoft = Surface.ByLoft(removeItemAtIndex)
explode = Geometry.Explode(byLoft)
unfoldListOfSurfaces_AndReturnTransforms = DynamoUnfold.Unfolding.UnfoldListOfSurfaces_AndReturnTransforms()
map = List.Map(explode, unfoldListOfSurfaces_AndReturnTransforms.out1)
mergeUnfoldingObjects = DynamoUnfold.Unfolding.MergeUnfoldingObjects(map)
code_block_6 = CodeBlock { 0.5; }
generateUnfoldedLabels = DynamoUnfold.Unfolding.GenerateUnfoldedLabels(mergeUnfoldingObjects, code_block_6)
map_2 = List.Map(explode, unfoldListOfSurfaces_AndReturnTransforms.out0)
perimeterCurves = Surface.PerimeterCurves(map_2)
