# Dynamo graph findrulinglinessimple.dyn (Dynamo 0.7.6.4256)

code_block = CodeBlock { Point.ByCoordinates(0,10,0); Point.ByCoordinates(5,5,0); Point.ByCoordinates(2,4,0); }
byThreePoints = Arc.ByThreePoints(code_block.out0, code_block.out1, code_block.out2)
code_block_2 = CodeBlock { Point.ByCoordinates(0,10,2); Point.ByCoordinates(5,5,2); Point.ByCoordinates(2,4,2); }
byThreePoints_2 = Arc.ByThreePoints(code_block_2.out0, code_block_2.out1, code_block_2.out2)
create = List.Create(byThreePoints, byThreePoints_2)
byLoft = Surface.ByLoft(create)
code_block_3 = CodeBlock { Point.ByCoordinates(0,0,0); Point.ByCoordinates(0,0,5); }
code_block_4 = CodeBlock { 4; }
byPointsRadius = Cone.ByPointsRadius(code_block_3.out0, code_block_3.out1, code_block_4)
explode = Geometry.Explode(byPointsRadius)
code_block_5 = CodeBlock(a=explode) { a[0]; }
byCenterPointRadius = Circle.ByCenterPointRadius(code_block_3.out0, code_block_4)
code_block_6 = CodeBlock { 0.5; }
horizontalFrameAtParameter = Curve.HorizontalFrameAtParameter(byCenterPointRadius, code_block_6)
ZXPlane = CoordinateSystem.ZXPlane(horizontalFrameAtParameter)
split = Geometry.Split(code_block_5, ZXPlane)
code_block_7 = CodeBlock(a=split) { a[0]; }
code_block_8 = CodeBlock { 0.01; }
findRulingLines = DynamoUnfold.Unfolding.findRulingLines(code_block_7, code_block_8)
flatten = Flatten(findRulingLines)
code_block_9 = CodeBlock(a=flatten) { a[0]; }
code_block_10 = CodeBlock(a=flatten) { a[1]; }
findRulingPatches = DynamoUnfold.Unfolding.findRulingPatches(code_block_7, code_block_8)
flatten_2 = Flatten(findRulingPatches)
unfoldListOfSurfaces = DynamoUnfold.Unfolding.UnfoldListOfSurfaces(flatten_2)
perimeterCurves = Surface.PerimeterCurves(unfoldListOfSurfaces)
