# Dynamo graph medium resolution tesselation and unfold.dyn (Dynamo 0.7.1.29029)

perimeterCurves = Surface.PerimeterCurves()
number = DoubleInput(4)
byCoordinates = Point.ByCoordinates(arg2=number)
number_2 = DoubleInput(1)
byCoordinates_2 = Point.ByCoordinates(number_2, number_2, number)
byCoordinates_3 = Point.ByCoordinates(arg1=number, arg2=number)
byThreePoints = Arc.ByThreePoints(byCoordinates, byCoordinates_2, byCoordinates_3)
byCoordinates_4 = Point.ByCoordinates()
number_3 = DoubleInput(2)
byCoordinates_5 = Point.ByCoordinates(number_3, number_3)
number_4 = DoubleInput(4)
byCoordinates_6 = Point.ByCoordinates(arg1=number_4)
byThreePoints_2 = Arc.ByThreePoints(byCoordinates_4, byCoordinates_5, byCoordinates_6)
create = List.Create(byThreePoints, byThreePoints_2)
byLoft = Surface.ByLoft(create)
code_block = CodeBlock { 6; }
scale = Geometry.Scale(byLoft, code_block)
code_block_2 = CodeBlock { 15; }
tesselateSurfaces = DynamoUnfold.Unfolding._TesselateSurfaces(scale, arg2=code_block_2)
unfoldListOfSurfaces_AndReturnTransforms = DynamoUnfold.Unfolding.UnfoldListOfSurfaces_AndReturnTransforms(tesselateSurfaces)
identity = Object.Identity(unfoldListOfSurfaces_AndReturnTransforms.out0)
code_block_3 = CodeBlock { 111; }
code_block_4 = CodeBlock { 12; }
packUnfoldedSurfaces = DynamoUnfold.Unfolding.PackUnfoldedSurfaces(unfoldListOfSurfaces_AndReturnTransforms.out1, code_block_3, code_block_3, code_block_4)
identity_2 = Object.Identity(packUnfoldedSurfaces.out0)
surfaces = PolySurface.Surfaces(identity_2)
perimeterCurves_2 = Surface.PerimeterCurves(surfaces)
code_block_5 = CodeBlock { 0.5; }
generateInitialLabels = DynamoUnfold.Unfolding.GenerateInitialLabels(packUnfoldedSurfaces.out1, code_block_5)
generateUnfoldedLabels = DynamoUnfold.Unfolding.GenerateUnfoldedLabels(packUnfoldedSurfaces.out1, code_block_5)
