# Dynamo graph testing packing.dyn (Dynamo 0.7.6.3557)

origin = Point.Origin()
code_block = CodeBlock { 10; }
byCenterPointRadius = Sphere.ByCenterPointRadius(origin, code_block)
bySolid = PolySurface.BySolid(byCenterPointRadius)
surfaces = PolySurface.Surfaces(bySolid)
flatten = Flatten(surfaces)
code_block_2 = CodeBlock { 0..1..#15; 0..1..#10; }
pointAtParameter = Surface.PointAtParameter(flatten, code_block_2.out0, code_block_2.out1, lacing=CrossProduct)
code_block_3 = CodeBlock { 1; }
flatten_2 = List.Flatten(pointAtParameter, code_block_3)
transpose = List.Transpose(flatten_2)
byPoints = PolyCurve.ByPoints(transpose)
flatten_3 = Flatten(byPoints)
code_block_4 = CodeBlock { 0..1; 1; }
sublists = List.Sublists(flatten_3, code_block_4.out0, code_block_4.out1)
code_block_5 = CodeBlock(l=sublists) { List.Count(l) - 1; }
removeItemAtIndex = List.RemoveItemAtIndex(sublists, code_block_5)
byLoft = Surface.ByLoft(removeItemAtIndex)
explode = Geometry.Explode(byLoft)
code_block_6 = CodeBlock { 25; }
translate = Geometry.Translate(explode, code_block_6)
unfoldListOfSurfaces_AndReturnTransforms = DynamoUnfold.Unfolding.UnfoldListOfSurfaces_AndReturnTransforms(translate)
mergeUnfoldingObjects = DynamoUnfold.Unfolding.MergeUnfoldingObjects(unfoldListOfSurfaces_AndReturnTransforms.out1)
code_block_7 = CodeBlock { 150; }
code_block_8 = CodeBlock { 10; }
packUnfoldedSurfaces = DynamoUnfold.Unfolding.PackUnfoldedSurfaces(mergeUnfoldingObjects, code_block_7, code_block_7, code_block_8)
generateUnfoldedLabels = DynamoUnfold.Unfolding.GenerateUnfoldedLabels(packUnfoldedSurfaces.out1)
generateUnfoldedLabels_2 = DynamoUnfold.Unfolding.GenerateUnfoldedLabels(mergeUnfoldingObjects)
code_block_9 = CodeBlock(a=generateUnfoldedLabels_2) { a[10]; }
code_block_10 = CodeBlock(a=unfoldListOfSurfaces_AndReturnTransforms.out0) { a[0][0][10]; }
code_block_11 = CodeBlock { 0.5; }
pointAtParameter_2 = Surface.PointAtParameter(code_block_10, code_block_11, code_block_11)
normalAtPoint = Surface.NormalAtPoint(code_block_10, pointAtParameter_2)
byOriginNormal = Plane.ByOriginNormal(pointAtParameter_2, normalAtPoint)
byPlane = CoordinateSystem.ByPlane(byOriginNormal)
X = Vector.X(pointAtParameter_2)
Y = Vector.Y(pointAtParameter_2)
code_block_12 = CodeBlock { 0; }
byCoordinates = Vector.ByCoordinates(X, Y, code_block_12)
asPoint = Vector.AsPoint(byCoordinates)
XAxis = Vector.XAxis()
YAxis = Vector.YAxis()
byOriginVectors = CoordinateSystem.ByOriginVectors(asPoint, XAxis, YAxis)
transform = Geometry.Transform(code_block_9, byPlane, byOriginVectors)
